# Grasshopper definition Day3_001_TheRiggedFrog.gh (Grasshopper 1.0.7)
# plug-ins: Kangaroo2 Components

trigger = Trigger(Interval=50, TimerInterval=50, Target=rec)
rec = DataRecorder("0", DataLimit=300, RecordData=True)
panel = Panel("1")
lng = ListLength(List=rec)
hiprotation = Slider(60, range=10..60)
sin = Sine(Value=lng)
multiplication = Multiplication(A=sin, B=hiprotation)
panel_2 = Panel(multiplication)

# ---- group: Name my group
# Doubleclick Me!
number_slider = Slider(0.213, range=0..1)  # disabled
number_slider_2 = Slider(12, range=0..100)  # disabled
# Doubleclick Me!
number_slider_3 = Slider(2, range=0..10)  # disabled
number_slider_4 = Slider(2, range=0..10)  # disabled
number_slider_5 = Slider(352, range=0..1000)  # disabled
number_slider_6 = Slider(23, range=10..90)  # disabled
number_slider_7 = Slider(1, range=0..1)  # disabled
boolean_toggle = BooleanToggle(False)  # disabled
button = Button()  # disabled

# ----
number_slider_8 = Slider(73, range=0..100)
footwidth = Slider(4.05, range=0..10)
lowerlegwidth = Slider(3.16, range=0..10)
footlength = Slider(8.53, range=0..10)
lowerleglength = Slider(10, range=0..10)
thighlength = Slider(10, range=0..10)
thighwidth = Slider(3.85, range=0..10)
frog_shaped_curve = Geometry(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)
panel_3 = Panel(".84")
panel_4 = Panel(number_slider_3)  # disabled

# ----
# The Rigged Flog
evaluate_curve = EvaluateCurve(Curve=reparameterize(frog_shaped_curve), Parameter=Slider(0.59, range=0..1))  # -> Point, Tangent, Angle
xy_plane = XYPlane(Origin=evaluate_curve.Point)

# ----
# Containers
point = Point(<point referenced from the Rhino model>)  # disabled
geometry = Geometry()  # disabled
curve = Curve()  # disabled
surface = Surface()  # disabled
brep = Brep()  # disabled

radians = Radians(Degrees=multiplication)
number_slider_9 = Slider(2, range=0..10)  # disabled
number_slider_10 = Slider(3, range=0..10)  # disabled
number_slider_11 = Slider(3, range=0..10)  # disabled
number_slider_12 = Slider(7, range=0..10)  # disabled
number_slider_13 = Slider(5, range=0..10)  # disabled
number_slider_14 = Slider(5, range=0..10)  # disabled
rotate_plane = RotatePlane(Plane=xy_plane, Angle=radians)
number_slider_15 = Slider(10, range=0..10)  # disabled
number_slider_16 = Slider(0, range=0..1)  # disabled
number_slider_17 = Slider(2, range=0..10)  # disabled
number_slider_18 = Slider(4.49, range=0..10)  # disabled
ellipse = Ellipse(Plane=rotate_plane, Radius1=thighwidth, Radius2=thighlength)  # -> Ellipse, Focus1, Focus2
vector_xyz = VectorXYZ(XComponent=number_slider_11, YComponent=number_slider_10, ZComponent=number_slider_9)  # -> Vector, Length; disabled
# Points
construct_point = ConstructPoint(XCoordinate=number_slider_12, YCoordinate=number_slider_13, ZCoordinate=number_slider_14)  # disabled
deconstruct = Deconstruct(Point=construct_point)  # -> XComponent, YComponent, ZComponent; disabled
deconstruct_vector = DeconstructVector(Vector=vector_xyz.Vector)  # -> XComponent, YComponent, ZComponent; disabled
point_2 = Point(ellipse.Focus2)
ellipse_2 = Ellipse(Plane=point_2, Radius1=lowerlegwidth, Radius2=lowerleglength)  # -> Ellipse, Focus1, Focus2
merge = Merge(Data1=deconstruct.XComponent, Data2=deconstruct.YComponent, Data3=deconstruct.ZComponent)  # disabled
merge_2 = Merge(Data1=deconstruct_vector.XComponent, Data2=deconstruct_vector.YComponent, Data3=deconstruct_vector.ZComponent)  # disabled
point_3 = Point(ellipse_2.Focus2)
point_4 = Point(ellipse_2.Focus1)
geometry_2 = Geometry(frog_shaped_curve)
ellipse_3 = Ellipse(Plane=rotate_plane, Radius1=footwidth, Radius2=footlength)  # -> Ellipse, Focus1, Focus2
# Series
series = Series(Start=number_slider_16, Step=number_slider_17, Count=number_slider_15)  # disabled
orient = Orient(Geometry=[ellipse_2.Ellipse, point_3], Source=point_4, Target=point_2)  # -> Geometry, Transform
point_5 = Point(ellipse_3.Focus1)
panel_5 = Panel(series)  # disabled
number_slider_19 = Slider(0, range=0..100)  # disabled
dispatch = Dispatch(List=orient.Geometry, DispatchPattern=[True, False])  # -> ListA, ListB
orient_2 = Orient(Geometry=ellipse_3.Ellipse, Source=point_5, Target=dispatch.ListB)  # -> Geometry, Transform
unit_z = UnitZ(Factor=number_slider_18)  # disabled
construct_point_2 = ConstructPoint(XCoordinate=series, YCoordinate=number_slider_19, ZCoordinate=number_slider_19)  # disabled
merge_3 = Merge(Data1=ellipse.Ellipse, Data2=dispatch.ListA, Data3=orient_2.Geometry)
move = Move(Geometry=construct_point_2, Motion=unit_z)  # -> Geometry, Transform; disabled
mirror = Mirror(Geometry=merge_3, Plane=PlaneYZ(0, 0, 0))  # -> Geometry, Transform
weave = Weave(Pattern=[0, 1], Stream0=construct_point_2, Stream1=move.Geometry, NullGaps=False)  # disabled
merge_4 = Merge(Data1=mirror.Geometry, Data2=merge_3, Data3=geometry_2, Data4=orient_2.Geometry)
merge_5 = Merge(Data1=construct_point_2, Data2=move.Geometry)  # disabled
number_slider_20 = Slider(6, range=1..100)  # disabled
region_union = RegionUnion(Curves=merge_4)
number_slider_21 = Slider(11, range=0..100)  # disabled

polyline = PolyLine(Vertices=weave, Closed=False)  # disabled
interpolate = Interpolate(Vertices=weave, Degree=3, Periodic=False, KnotStyle=1)  # -> Curve, Length, Domain; disabled
nurbs_curve = NurbsCurve(Vertices=weave, Degree=3, Periodic=False)  # -> Curve, Length, Domain; disabled

boundary_surfaces = BoundarySurfaces(Edges=region_union)
unit_y = UnitY(Factor=number_slider_21)  # disabled
unit_y_2 = UnitY(Factor=number_slider_20)  # disabled
unit_y_3 = UnitY(Factor=multiplication)
negative = Negative(Value=unit_y)  # disabled
move_2 = Move(Geometry=polyline, Motion=unit_y_2)  # -> Geometry, Transform; disabled
move_3 = Move(Geometry=nurbs_curve.Curve, Motion=negative)  # -> Geometry, Transform; disabled
move_4 = Move(Geometry=boundary_surfaces, Motion=unit_y_3)  # -> Geometry, Transform
merge_6 = Merge(Data1=move_2.Geometry, Data2=interpolate.Curve, Data3=move_3.Geometry)  # disabled
panel_6 = Panel(merge)  # disabled
panel_7 = Panel(merge_2)  # disabled
loft = Loft(Curves=merge_6, Options={Adjust=False, Closed=False, LoftEnds=0, LoftSimp=0, LoftType=0, Rebuild=10, Refit=0.01})  # disabled
# Plane Creation
xy_plane_2 = XYPlane(Origin=construct_point)  # disabled
xz_plane = XZPlane(Origin=construct_point)  # disabled
yz_plane = YZPlane(Origin=construct_point)  # disabled
number_slider_22 = Slider(20, range=0..100)  # disabled
number_slider_23 = Slider(4, range=0..10)  # disabled
number_slider_24 = Slider(0, range=0..10)  # disabled
polygon = Polygon(Plane=yz_plane, Radius=number_slider_22, Segments=number_slider_23, FilletRadius=number_slider_24)  # -> Polygon, Length; disabled
rectangle = Rectangle(Plane=xz_plane, XSize=number_slider_22, YSize=number_slider_22, Radius=number_slider_24)  # -> Rectangle, Length; disabled
# Curve Creation
circle = Circle(Plane=xy_plane_2, Radius=number_slider_22)  # disabled
merge_7 = Merge(Data1=circle, Data2=rectangle.Rectangle, Data3=polygon.Polygon)  # disabled
number_slider_25 = Slider(2, range=0..10)  # disabled
# Brep (Boundary Represention)
# Surface Creation
multipipe = MultiPipe(Curves=merge_7, NodeSize=number_slider_25, EndOffset=1, StrutSize=1, Segment=0, KinkAngle=0.6, CubeFit=0, Caps=0)  # disabled
panel_8 = Panel(merge_5)  # disabled
number_slider_26 = Slider(34, range=10..60)  # disabled
masterleg = Slider(0.83, range=0..1)  # disabled
# Intersections
geometry_3 = Geometry(<curve referenced from the Rhino model>)  # disabled

evaluate_curve_2 = EvaluateCurve(Curve=reparameterize(geometry_3), Parameter=masterleg)  # -> Point, Tangent, Angle; disabled
# Transformations
xy_plane_3 = XYPlane(Origin=evaluate_curve_2.Point)  # disabled

radians_2 = Radians(Degrees=number_slider_26)  # disabled
rotate_plane_2 = RotatePlane(Plane=xy_plane_3, Angle=radians_2)  # disabled

number_slider_27 = Slider(3.49, range=0..10)  # disabled
number_slider_28 = Slider(10, range=0..10)  # disabled
ellipse_4 = Ellipse(Plane=rotate_plane_2, Radius1=number_slider_27, Radius2=number_slider_28)  # -> Ellipse, Focus1, Focus2; disabled
point_6 = Point(ellipse_4.Focus1)  # disabled

point_7 = Point(ellipse_4.Focus2)  # disabled

number_slider_29 = Slider(2.81, range=0..10)  # disabled
number_slider_30 = Slider(10, range=0..10)  # disabled
ellipse_5 = Ellipse(Plane=point_7, Radius1=number_slider_29, Radius2=number_slider_30)  # -> Ellipse, Focus1, Focus2; disabled
point_8 = Point(ellipse_5.Focus1)  # disabled

orient_3 = Orient(Geometry=ellipse_5.Ellipse, Source=point_8, Target=point_7)  # -> Geometry, Transform; disabled
geometry_4 = Geometry(geometry_3)  # disabled
merge_8 = Merge(Data1=ellipse_4.Ellipse, Data2=orient_3.Geometry)  # disabled
mirror_2 = Mirror(Geometry=merge_8, Plane=PlaneYZ(0, 0, 0))  # -> Geometry, Transform; disabled
merge_9 = Merge(Data1=mirror_2.Geometry, Data2=merge_8, Data3=geometry_4)  # disabled
region_union_2 = RegionUnion(Curves=merge_9)  # disabled
unit_z_2 = UnitZ(Factor=1)  # disabled
number_slider_31 = Slider(29, range=0..100)  # disabled
extrude = Extrude(Base=region_union_2, Direction=unit_z_2)  # disabled
unit_y_4 = UnitY(Factor=number_slider_31)  # disabled
cap_holes = CapHoles(Brep=extrude)  # disabled
move_5 = Move(Geometry=cap_holes, Motion=unit_y_4)  # -> Geometry, Transform; disabled
