# Grasshopper definition EssentialGrasshopperForRhino3D(beginner)PartI.gh (Grasshopper 1.0.7)
# plug-ins: Kangaroo2 Components

# Doubleclick Me!
# Doubleclick Me!
number_slider = Slider(0.522, range=0..1)
number_slider_2 = Slider(3, range=0..10)
number_slider_3 = Slider(57, range=0..100)
number_slider_4 = Slider(2, range=0..10)
panel = Panel([number_slider, Toggle(True), Slider(1, range=0..1)])

# ----
# Param Containers
point = Point(<point referenced from the Rhino model>)
surface = Surface(<surface referenced from the Rhino model>)
geometry = Geometry([<point referenced from the Rhino model>, <curve referenced from the Rhino model>, <brep referenced from the Rhino model> x2])
curve = Curve(<curve referenced from the Rhino model>)
brep = Brep(<brep referenced from the Rhino model>)

panel_2 = Panel(geometry)
number_slider_5 = Slider(4, range=0..10)
number_slider_6 = Slider(5, range=0..10)
number_slider_7 = Slider(4, range=0..10)
# Point Creation
construct_point = ConstructPoint(XCoordinate=number_slider_6, YCoordinate=number_slider_6, ZCoordinate=number_slider_6)
deconstruct = Deconstruct(Point=construct_point)  # -> XComponent, YComponent, ZComponent
vector_xyz = VectorXYZ(XComponent=number_slider_5, YComponent=number_slider_5, ZComponent=number_slider_5)  # -> Vector, Length
deconstruct_vector = DeconstructVector(Vector=vector_xyz.Vector)  # -> XComponent, YComponent, ZComponent
construct_domain = ConstructDomain(DomainStart=Slider(0, range=0..10), DomainEnd=number_slider_7)
start = Start(0)
step = Step(1)
count = Count(number_slider_7)
panel_3 = Panel([deconstruct.XComponent, deconstruct.YComponent, deconstruct.ZComponent])
number_slider_8 = Slider(1.03, range=0..10)
series = Series(Start=start, Step=step, Count=count)
range = Range(Domain=construct_domain, Steps=expr("x-1", count))
panel_4 = Panel(start)
unit_z = UnitZ(Factor=number_slider_8)
unit_y = UnitY(Factor=number_slider_8)
# Planes Creation
xy_plane = XYPlane(Origin=construct_point)
yz_plane = YZPlane(Origin=construct_point)
xz_plane = XZPlane(Origin=construct_point)
construct_plane = ConstructPlane(Origin=Point(0, 0, 0), XAxis=Vector(1, 0, 0), YAxis=Vector(0, 1, 0))
construct_point_2 = ConstructPoint(XCoordinate=range, YCoordinate=start, ZCoordinate=start)
move = Move(Geometry=construct_point_2, Motion=unit_z)  # -> Geometry, Transform
number_slider_9 = Slider(7, range=0..10)
weave = Weave(Pattern=[0, 1], Stream0=construct_point_2, Stream1=move.Geometry, NullGaps=False)
number_slider_10 = Slider(4, range=0..100)
polygon = Polygon(Plane=yz_plane, Radius=number_slider_9, Segments=Slider(4, range=0..10), FilletRadius=Slider(3, range=0..10))  # -> Polygon, Length
line = Line()
rectangle = Rectangle(Plane=xy_plane, XSize=number_slider_9, YSize=number_slider_9, Radius=Slider(2, range=0..10))  # -> Rectangle, Length
# Curve Creation
circle = Circle(Plane=xy_plane, Radius=number_slider_9)
interpolate = Interpolate(Vertices=weave, Degree=3, Periodic=False, KnotStyle=1)  # -> Curve, Length, Domain
polyline = PolyLine(Vertices=weave, Closed=False)
nurbs_curve = NurbsCurve(Vertices=weave, Degree=3, Periodic=False)  # -> Curve, Length, Domain
negative = Negative(Value=number_slider_10)
unit_y_2 = UnitY(Factor=negative)
unit_y_3 = UnitY(Factor=number_slider_10)
merge = Merge(Data1=circle, Data2=rectangle.Rectangle, Data3=polygon.Polygon)
number_slider_11 = Slider(0.47, range=0..1)
curve_2 = Curve(reparameterize(nurbs_curve.Curve))
move_2 = Move(Geometry=polyline, Motion=unit_y_3)  # -> Geometry, Transform
move_3 = Move(Geometry=nurbs_curve.Curve, Motion=unit_y_2)  # -> Geometry, Transform
curvature = Curvature(Curve=curve_2, Parameter=number_slider_11)  # -> Point, Curvature, Curvature_2
evaluate_curve = EvaluateCurve(Curve=curve_2, Parameter=number_slider_11)  # -> Point, Tangent, Angle
# Curve Analysis
curve_middle = CurveMiddle(Curve=curve_2)
point_on_curve = PointOnCurve(curve_2, parameter=0.302)
end_points = EndPoints(Curve=curve_2)  # -> Start, End
merge_2 = Merge(Data1=move_2.Geometry, Data2=interpolate.Curve, Data3=move_3.Geometry)
perp_frames = PerpFrames(Curve=curve_2, Count=10, Align=True)  # -> Frames, Parameters
horizontal_frames = HorizontalFrames(Curve=curve_2, Count=10)  # -> Frames, Parameters
# Curve Division
divide_curve = DivideCurve(Curve=curve_2, Count=Slider(7, range=0..10), Kinks=False)  # -> Points, Tangents, Parameters
explode = Explode(Recursive=True)  # -> Segments, Vertices
join_curves = JoinCurves(Preserve=False)
flip_curve = FlipCurve()  # -> Curve, Flag
multipipe = MultiPipe(Curves=merge, NodeSize=Slider(1.39, range=0..10), EndOffset=1, StrutSize=1, Segment=0, KinkAngle=0.6, CubeFit=0, Caps=0)
cylinder = Cylinder(Base=PlaneXY(0, 0, 0), Radius=0.5, Length=1)
sphere = Sphere(Base=PlaneXY(0, 0, 0), Radius=1)
loft = Loft(Curves=merge_2, Options={Adjust=False, Closed=False, LoftEnds=0, LoftSimp=0, LoftType=0, Rebuild=10, Refit=0.01})
quad_sphere = QuadSphere(Base=PlaneXY(0, 0, 0), Radius=1)
# Surface Creation
cone = Cone(Base=PlaneXY(0, 0, 0), Radius=0.5, Length=1)  # -> Cone, Tip
brep_2 = Brep(loft)
# Surface Analysis
deconstruct_brep = DeconstructBrep(Brep=brep_2)  # -> Faces, Edges, Vertices
point_2 = Point(deconstruct_brep.Vertices)
surface_2 = Surface(deconstruct_brep.Faces)
curve_3 = Curve(deconstruct_brep.Edges)
list_item = ListItem(List=surface_2, Index=0, Wrap=True)  # -> Item, Item1, Item2, Item3, Item4, Item5, Item6
md_slider = MDSlider(
    SliderMode=0,
    slider_value=Point(0.7090230802, 0.6012193633, 0.5),
    x_domain=Domain(0, 1),
    y_domain=Domain(0, 1),
    z_domain=Domain(0, 1))
construct_point_3 = ConstructPoint(XCoordinate=Slider(0.5, range=0..1), YCoordinate=Slider(0.5, range=0..1), ZCoordinate=0)
number_slider_12 = Slider(5, range=0..10)
panel_5 = Panel(surface_2)
surface_3 = Surface(list_item.Item1)
area = Area(Geometry=surface_3)  # -> Area, Centroid
volume = Volume()  # -> Volume, Centroid
evaluate_surface = EvaluateSurface(Surface=reparameterize(surface_3), Point=construct_point_3)  # -> Point, Normal, UDirection, VDirection, Frame
divide_surface = DivideSurface(Surface=surface_3, UCount=number_slider_12, VCount=number_slider_12)  # -> Points, Normals, Parameters
divide_domain² = DivideDomain²(Domain=surface_3, UCount=number_slider_12, VCount=number_slider_12)
point_3 = Point(area.Centroid)
vector = Vector(divide_surface.Normals)
point_4 = Point(divide_surface.Points)
iso_curve = IsoCurve(Surface=surface_3, UVPoint=divide_surface.Parameters)  # -> UIsocurve, VIsocurve
isotrim = Isotrim(Surface=surface_3, Domain=divide_domain²)
vector_display = VectorDisplay(Anchor=point_4, Vector=vector)
# Transformations
scale = Scale(Center=Point(0, 0, 0), Factor=0.5)  # -> Geometry, Transform
move_4 = Move(Motion=Vector(0, 0, 10))  # -> Geometry, Transform
orient = Orient(Source=PlaneXY(0, 0, 0), Target=PlaneXY(0, 0, 0))  # -> Geometry, Transform
linear_array = LinearArray(Direction=Vector(10, 0, 0), Count=10)  # -> Geometry, Transform
polar_array = PolarArray(Plane=PlaneXY(0, 0, 0), Count=10, Angle=6.283185307)  # -> Geometry, Transform
project = Project(Plane=PlaneXY(0, 0, 0))  # -> Geometry, Transform
scale_nu = ScaleNU(Plane=PlaneXY(0, 0, 0), ScaleX=1, ScaleY=1, ScaleZ=1)  # -> Geometry, Transform
mirror = Mirror(Plane=PlaneYZ(0, 0, 0))  # -> Geometry, Transform
text_tag_3d = TextTag3D(Size=1, Justification=7)
text_tag = TextTag()
