# Grasshopper definition EssentialGrasshopperForRhino3D(beginner)PartII.gh (Grasshopper 1.0.7)
# plug-ins: Kangaroo2 Components, Bifocals

# Essential Grasshopper for Rhino 3D
# Doubleclick Me!
# Doubleclick Me!
number_slider = Slider(0.522, range=0..1)
number_slider_2 = Slider(3, range=0..10)
number_slider_3 = Slider(57, range=0..100)
number_slider_4 = Slider(2, range=0..10)
panel = Panel([number_slider, Toggle(True), Slider(1, range=0..1)])

# ----
# Param Containers
pt = Point(<point referenced from the Rhino model>)
srf = Surface(<surface referenced from the Rhino model>)
geo = Geometry([<point referenced from the Rhino model>, <curve referenced from the Rhino model>, <brep referenced from the Rhino model> x2])
crv = Curve(<curve referenced from the Rhino model>)
brep = Brep(<brep referenced from the Rhino model>)

panel_2 = Panel(geo)
number_slider_5 = Slider(4, range=0..10)
number_slider_6 = Slider(5, range=0..10)
number_slider_7 = Slider(3, range=0..10)
# Point Creation
pt_2 = ConstructPoint(XCoordinate=number_slider_6, YCoordinate=number_slider_6, ZCoordinate=number_slider_6)
pdecon = Deconstruct(Point=pt_2)  # -> XComponent, YComponent, ZComponent
vec = VectorXYZ(XComponent=number_slider_5, YComponent=number_slider_5, ZComponent=number_slider_5)  # -> Vector, Length
devec = DeconstructVector(Vector=vec.Vector)  # -> XComponent, YComponent, ZComponent
dom = ConstructDomain(DomainStart=Slider(0, range=0..10), DomainEnd=number_slider_7)
start = Start(0)
step = Step(1)
count = Count(number_slider_7)
panel_3 = Panel([pdecon.XComponent, pdecon.YComponent, pdecon.ZComponent])
number_slider_8 = Slider(1.03, range=0..10)
series = Series(Start=start, Step=step, Count=count)
range = Range(Domain=dom, Steps=expr("x-1", count))
panel_4 = Panel(start)
Z = UnitZ(Factor=number_slider_8)
Y = UnitY(Factor=number_slider_8)
# Planes Creation
xy = XYPlane(Origin=pt_2)
yz = YZPlane(Origin=pt_2)
xz = XZPlane(Origin=pt_2)
pl = ConstructPlane(Origin=Point(0, 0, 0), XAxis=Vector(1, 0, 0), YAxis=Vector(0, 1, 0))
pt_3 = ConstructPoint(XCoordinate=range, YCoordinate=start, ZCoordinate=start)
move = Move(Geometry=pt_3, Motion=Z)  # -> Geometry, Transform
number_slider_9 = Slider(7, range=0..10)
weave = Weave(Pattern=[0, 1], Stream0=pt_3, Stream1=move.Geometry, NullGaps=False)
number_slider_10 = Slider(4, range=0..100)
rectangle = Rectangle(Plane=xy, XSize=number_slider_9, YSize=number_slider_9, Radius=Slider(2, range=0..10))  # -> Rectangle, Length
# Curve Creation
cir = Circle(Plane=xy, Radius=number_slider_9)
ln = Line()
polygon = Polygon(Plane=yz, Radius=number_slider_9, Segments=Slider(4, range=0..10), FilletRadius=Slider(3, range=0..10))  # -> Polygon, Length
pline = PolyLine(Vertices=weave, Closed=False)
neg = Negative(Value=number_slider_10)
nurbs = NurbsCurve(Vertices=weave, Degree=3, Periodic=False)  # -> Curve, Length, Domain
intcrv = Interpolate(Vertices=weave, Degree=3, Periodic=False, KnotStyle=1)  # -> Curve, Length, Domain
merge = Merge(Data1=cir, Data2=rectangle.Rectangle, Data3=polygon.Polygon)
Y_2 = UnitY(Factor=neg)
Y_3 = UnitY(Factor=number_slider_10)
number_slider_11 = Slider(0.47, range=0..1)
# Curve Analysis
crv_2 = Curve(reparameterize(nurbs.Curve))
move_2 = Move(Geometry=pline, Motion=Y_3)  # -> Geometry, Transform
move_3 = Move(Geometry=nurbs.Curve, Motion=Y_2)  # -> Geometry, Transform
curvepoint = PointOnCurve(crv_2, parameter=0.302)
midpt = CurveMiddle(Curve=crv_2)
curvature = Curvature(Curve=crv_2, Parameter=number_slider_11)  # -> P, K, C
end = EndPoints(Curve=crv_2)  # -> Start, End
eval = EvaluateCurve(Curve=crv_2, Parameter=number_slider_11)  # -> Point, Tangent, Angle
merge_2 = Merge(Data1=move_2.Geometry, Data2=intcrv.Curve, Data3=move_3.Geometry)
pframes = PerpFrames(Curve=crv_2, Count=10, Align=True)  # -> Frames, Parameters
hframes = HorizontalFrames(Curve=crv_2, Count=10)  # -> Frames, Parameters
# Curve Division
divide = DivideCurve(Curve=crv_2, Count=Slider(7, range=0..10), Kinks=False)  # -> Points, Tangents, Parameters
flip = FlipCurve()  # -> Curve, Flag
explode = Explode(Recursive=True)  # -> Segments, Vertices
join = JoinCurves(Preserve=False)
mp = MultiPipe(Curves=merge, NodeSize=Slider(1.39, range=0..10), EndOffset=1, StrutSize=1, Segment=0, KinkAngle=0.6, CubeFit=0, Caps=0)
cyl = Cylinder(Base=PlaneXY(0, 0, 0), Radius=0.5, Length=1)
sph = Sphere(Base=PlaneXY(0, 0, 0), Radius=1)
qsph = QuadSphere(Base=PlaneXY(0, 0, 0), Radius=1)
loft = Loft(Curves=merge_2, Options={Adjust=False, Closed=False, LoftEnds=0, LoftSimp=0, LoftType=0, Rebuild=10, Refit=0.01})
# Surface Creation
cone = Cone(Base=PlaneXY(0, 0, 0), Radius=0.5, Length=1)  # -> Cone, Tip
brep_2 = Brep(loft)
# Surface Analysis
debrep = DeconstructBrep(Brep=brep_2)  # -> Faces, Edges, Vertices
pt_4 = Point(debrep.Vertices)
srf_2 = Surface(debrep.Faces)
crv_3 = Curve(debrep.Edges)
md_slider = MDSlider(
    SliderMode=0,
    slider_value=Point(0.7090230802, 0.6012193633, 0.5),
    x_domain=Domain(0, 1),
    y_domain=Domain(0, 1),
    z_domain=Domain(0, 1))
item = ListItem(List=srf_2, Index=0, Wrap=True)  # -> Item, Item1, Item2, Item3, Item4, Item5, Item6
pt_5 = ConstructPoint(XCoordinate=Slider(0.5, range=0..1), YCoordinate=Slider(0.5, range=0..1), ZCoordinate=0)
panel_5 = Panel(srf_2)
srf_3 = Surface(item.Item)
srf_4 = Surface(srf_2)
geo_2 = Geometry(srf_4)

# ----
# Surface SubD Forms
# with Pathmapper
number_slider_12 = Slider(2, range=-1..3)
divide_2 = DivideDomain²(Domain=geo_2, UCount=number_slider_12, VCount=number_slider_12)
subsrf = Isotrim(Surface=graft(geo_2), Domain=divide_2)  # -> flatten(Surface)
sdivide = DivideSurface(Surface=geo_2, UCount=number_slider_12, VCount=number_slider_12)  # -> Points, Normals, Parameters
srf_5 = Surface(subsrf)
iso = IsoCurve(Surface=geo_2, UVPoint=sdivide.Parameters)  # -> UIsocurve, VIsocurve
area = Area(Geometry=srf_5)  # -> Area, Centroid
vec_2 = Vector(sdivide.Normals)
pt_6 = Point(sdivide.Points)
amp = Amplitude(Vector=vec_2, Amplitude=Slider(0.5, range=0..2))
vdis = VectorDisplay(Anchor=pt_6, Vector=vec_2)
scale = Scale(Geometry=srf_5, Center=area.Centroid, Factor=Slider(0.34, range=0.01..1))  # -> Geometry, Transform
move_4 = Move(Geometry=scale.Geometry, Motion=amp)  # -> simplify(Geometry), Transform
path_mapper = PathMapper(move_4.Geometry, source="{A;B}(i)", target="{A;i}(B)")
viewer = ParamViewer(move_4.Geometry)
viewer_2 = ParamViewer(path_mapper)
cull_i = CullIndex(List=path_mapper, Indices=Slider(0, range=0..2), Wrap=True)
loft_2 = Loft(Curves=cull_i, Options={Adjust=False, Closed=False, LoftEnds=0, LoftSimp=0, LoftType=0, Rebuild=10, Refit=0.01})
debrep_2 = DeconstructBrep(Brep=loft_2)  # -> Faces, Edges, Vertices
mp_2 = MultiPipe(
    Curves=debrep_2.Edges,
    NodeSize=Slider(0.006, range=0..0.01),
    EndOffset=1,
    StrutSize=1,
    Segment=0,
    KinkAngle=0.6,
    CubeFit=0,
    Caps=0)

area_2 = Area(Geometry=srf_3)  # -> Area, Centroid
volume = Volume()  # -> Volume, Centroid
evalsrf = EvaluateSurface(Surface=reparameterize(srf_3), Point=pt_5)  # -> Point, Normal, UDirection, VDirection, Frame
evalsrf_2 = EvaluateSurface(Surface=reparameterize(srf_4), Point=pt_5)  # -> Point, Normal, UDirection, VDirection, Frame
pt_7 = Point(area_2.Centroid)
# Transformations
scale_2 = Scale(Center=Point(0, 0, 0), Factor=0.5)  # -> Geometry, Transform
move_5 = Move(Motion=Vector(0, 0, 10))  # -> Geometry, Transform
orient = Orient(Source=PlaneXY(0, 0, 0), Target=PlaneXY(0, 0, 0))  # -> Geometry, Transform
arrlinear = LinearArray(Direction=Vector(10, 0, 0), Count=10)  # -> Geometry, Transform
arrpolar = PolarArray(Plane=PlaneXY(0, 0, 0), Count=10, Angle=6.283185307)  # -> Geometry, Transform
project = Project(Plane=PlaneXY(0, 0, 0))  # -> Geometry, Transform
scale_nu = ScaleNU(Plane=PlaneXY(0, 0, 0), ScaleX=1, ScaleY=1, ScaleZ=1)  # -> Geometry, Transform
mirror = Mirror(Plane=PlaneYZ(0, 0, 0))  # -> Geometry, Transform
tag = TextTag()
tag_2 = TextTag3D(Size=1, Justification=7)
