# Grasshopper definition Learning_Lunchbox_002.gh (Grasshopper 1.0.7)
# plug-ins: LunchBox, Bifocals

# ----
# Sample .gh scripts on github
gene_pool = GenePool(Decimals=0, Maximum=40, Minimum=0, Value=[0, 20, 40])  # disabled
gene_pool_2 = GenePool(Decimals=0, Maximum=50, Minimum=0, Value=[20, 10, 25])  # disabled
construct_point = ConstructPoint(XCoordinate=0, YCoordinate=0, ZCoordinate=gene_pool)  # disabled
circle = Circle(Plane=construct_point, Radius=gene_pool_2)  # disabled
number_slider = Slider(22, range=0..100)  # disabled
number_slider_2 = Slider(16, range=0..100)  # disabled
loft = Loft(Curves=circle, Options={Adjust=False, Closed=False, LoftEnds=0, LoftSimp=0, LoftType=0, Rebuild=10, Refit=0.01})  # disabled
diagrid_structure = DiagridStructure(Surface=loft, UDivisions=number_slider_2, VDivisions=number_slider, Type=True)  # -> StructureLines, StructureNodes; disabled
number_slider_3 = Slider(0.018, range=0..0.1)  # disabled
number_slider_4 = Slider(0.03, range=0..0.1)  # disabled
construct_domain = ConstructDomain(DomainStart=expr("-x/2", number_slider_4), DomainEnd=expr("x/2", number_slider_4))  # disabled
curve = Curve(diagrid_structure.StructureLines)  # disabled
construct_domain_2 = ConstructDomain(DomainStart=expr("-x/2", number_slider_3), DomainEnd=expr("x/2", number_slider_3))  # disabled
perp_frames = PerpFrames(Curve=curve, Count=10, Align=True)  # -> Frames, Parameters; disabled
rectangle = Rectangle(Plane=perp_frames.Frames, XSize=construct_domain, YSize=construct_domain_2, Radius=0)  # -> Rectangle, Length; disabled
loft_2 = Loft(
    Curves=rectangle.Rectangle,
    Options={Adjust=False, Closed=False, LoftEnds=0, LoftSimp=0, LoftType=0, Rebuild=10, Refit=0.01})  # disabled

create_csv = CreateCSV(Delimiter=",")
create_datatable = CreateDataTable()
read_xml_by_tag = ReadXMLByTag()  # -> XMLInnerText, XMLInnerXML
convert_json_to_xml = ConvertJSONToXML()
convert_xml_to_json = ConvertXMLToJSON()
# Lunchbox Plug-in Creative
# Data
create_dataset = CreateDataSet()
read_csv = ReadCSV(Delimiter=",")  # -> Headers, Values
create_json = CreateJSON(WriteJSON=False)
create_chart = CreateChart(ChartName="My Chart", Chart_Theme="Bright Pastel", Chart_Type="Column")
create_data_grid = CreateDataGrid()
create_xml = CreateXML(WriteXML=False)
create_xml_2 = CreateXML(WriteXML=False)

panel = Panel("""50
44
12
10
5""")
panel_2 = Panel("""Michael
Beth
Oscar
Max
Ella""")
text = Text("DataSet_A")
create_datatable_2 = CreateDataTable(TableName="Wickerson", TableHeaders=panel_2, ValueTree=graft(panel))
create_dataset_2 = CreateDataSet(DataSetName=text, DataTables=create_datatable_2)
read_xml_by_tag_2 = ReadXMLByTag()  # -> XMLInnerText, XMLInnerXML
create_json_2 = CreateJSON(WriteJSON=False, DataSet=create_dataset_2)
create_xml_3 = CreateXML(WriteXML=False, DataTree=create_dataset_2)
create_xml_4 = CreateXML(WriteXML=False, DataSet=create_dataset_2)
panel_3 = Panel("""1
2
3""")
panel_4 = Panel("""4
5
6""")
panel_5 = Panel("""7
8
9""")
convert_json_to_xml_2 = ConvertJSONToXML(JSONString=create_json_2)
convert_xml_to_json_2 = ConvertXMLToJSON(XMLString=create_xml_4)
entwine = Entwine(Branch00=panel_3, Branch01=panel_4, Branch02=panel_5, FlattenInputs=True)
panel_6 = Panel(create_json_2)
panel_7 = Panel(create_xml_4)
panel_8 = Panel("""First
Second
Third""")
create_csv_2 = CreateCSV(DataGridHeaders="MyFirstLunchboxVAlueTree", ValueTree=entwine, Delimiter=",")
create_data_grid_2 = CreateDataGrid(DataGridHeaders=panel_8, ValueTree=entwine)
create_chart_2 = CreateChart(
    ChartName="Chart Name",
    ChartSeries="Chart Series",
    ChartXAxisLabels="x-axis label",
    ValueTree=entwine,
    Chart_Theme="Berry",
    Chart_Type="Bar")
panel_9 = Panel(create_csv_2)
read_csv_2 = ReadCSV(CSVString=create_csv_2, Delimiter=",")  # -> Headers, Values
panel_10 = Panel(read_csv_2.Values)
panel_11 = Panel(read_csv_2.Headers)

subdivide_triangle = SubdivideTriangle(Subdivide=2, Boolean1=True, Boolean2=True, Boolean3=True, Boolean4=True, Wires=True)  # -> TriangleCellsA, TriangleCellsB
constant_quad_subdivide = ConstantQuadSubdivide(Subdivide=2, RecursionToggle=True, Wires=True)
subdivide_quad = SubdivideQuad(Subdivide=2, Boolean1=True, Boolean2=True, Boolean3=True, Boolean4=True, Wires=True)  # -> QuadCellsA, QuadCellsB
panel_frame = PanelFrame(ScaleFactor=0.5)  # -> PanelFrame, Panel
attractor_wave = AttractorWave(AttractorDomain=Domain(-1, 1), Frequency=0.5)  # -> Values, Vectors, Distances
# Generate
attractor = Attractor(AttractorDomain=Domain(0, 1))  # -> Values, Vectors, Distances
number_slider_5 = Slider(100, range=0..100)

number_slider_6 = Slider(100, range=0..100)
xz_plane = XZPlane(Origin=Point(0, 0, 0))
number_slider_7 = Slider(3, range=0..20)
construct_domain_3 = ConstructDomain(DomainStart=0, DomainEnd=number_slider_6)
rectangle_2 = Rectangle(Plane=xz_plane, XSize=number_slider_6, YSize=number_slider_6, Radius=0)  # -> Rectangle, Length
range = Range(Domain=construct_domain_3, Steps=expr("x-1", Slider(12, range=0..100)))
populate_2d = Populate2D(Region=rectangle_2.Rectangle, Count=number_slider_7, Seed=number_slider_7)
unit_y = UnitY(Factor=number_slider_6)
sine = Sine(Value=range)
move = Move(Geometry=populate_2d, Motion=unit_y)  # -> Geometry, Transform
construct_point_2 = ConstructPoint(XCoordinate=range, YCoordinate=0, ZCoordinate=sine)
point = Point(move.Geometry)
point_2 = Point(construct_point_2)
attractor_2 = Attractor(AttractorPoints=point, TargetPoints=point_2, AttractorDomain=Slider(1, range=0..1))  # -> Values, Vectors, Distances
panel_12 = Panel(attractor_2.Values)
amplitude = Amplitude(Vector=attractor_2.Vectors, Amplitude=attractor_2.Distances)
vector_display = VectorDisplay(Anchor=point_2, Vector=amplitude)

gene_pool_3 = GenePool(
    Decimals=0,
    Maximum=100,
    Minimum=0,
    Value=[60.03920769, 25.5697861, 75.04332283, 32.27183844, 70.34212959, 1.449973649, 14.23746716, 41.03646639, 65.1922745, 29.26254511])
xz_plane_2 = XZPlane(Origin=Point(0, 0, 0))
construct_domain_4 = ConstructDomain(DomainStart=0, DomainEnd=number_slider_5)
rectangle_3 = Rectangle(Plane=xz_plane_2, XSize=number_slider_5, YSize=number_slider_5, Radius=0)  # -> Rectangle, Length
range_2 = Range(Domain=construct_domain_4, Steps=expr("x-1", Slider(22, range=0..100)))
populate_2d_2 = Populate2D(Region=rectangle_3.Rectangle, Count=Slider(3, range=0..20), Seed=gene_pool_3)
unit_y_2 = UnitY(Factor=number_slider_5)
sine_2 = Sine(Value=range_2)
move_2 = Move(Geometry=populate_2d_2, Motion=unit_y_2)  # -> Geometry, Transform
construct_point_3 = ConstructPoint(XCoordinate=range_2, YCoordinate=0, ZCoordinate=sine_2)
frequency = Slider(0.61, range=0..1)
amplification = Slider(5, range=0..100)
point_3 = Point(construct_point_3)
point_4 = Point(move_2.Geometry)
attractor_wave_2 = AttractorWave(AttractorPoints=point_4, TargetPoints=point_3, AttractorDomain=Slider(1, range=0..1), Frequency=frequency)  # -> Values, Vectors, Distances
panel_13 = Panel(attractor_wave_2.Values)
amplitude_2 = Amplitude(Vector=attractor_wave_2.Vectors, Amplitude=attractor_wave_2.Distances)
amplitude_3 = Amplitude(Vector=amplitude_2, Amplitude=amplification)
vector_display_2 = VectorDisplay(Anchor=point_3, Vector=amplitude_2)
move_3 = Move(Geometry=point_3, Motion=amplitude_3)  # -> Geometry, Transform
nurbs_curve = NurbsCurve(Vertices=move_3.Geometry, Degree=3, Periodic=False)  # -> Curve, Length, Domain
list_length = ListLength(List=flatten(nurbs_curve.Curve))
series = Series(Start=0, Step=list_length, Count=10)
unit_z = UnitZ(Factor=series)
move_4 = Move(Geometry=flatten(nurbs_curve.Curve), Motion=unit_z)  # -> Geometry, Transform
loft_3 = Loft(Curves=move_4.Geometry, Options={Adjust=False, Closed=False, LoftEnds=0, LoftSimp=0, LoftType=0, Rebuild=10, Refit=0.01})
brep_edges = BrepEdges(Brep=loft_3)  # -> Naked, Interior, NonManifold
unit_y_3 = UnitY(Factor=Slider(19, range=0..100))
curve_2 = Curve(brep_edges.Naked)
extrude = Extrude(Base=[curve_2, loft_3], Direction=unit_y_3)
custom_preview = CustomPreview(Geometry=extrude, Material=ColourSwatch(SwatchColor=RGB(0, 255, 255)))
